# Grasshopper definition DiTWP_UE_W25_12002332_gh-modell.gh (Grasshopper 1.0.8)
# plug-ins: Speckle.Connector.Grasshopper, sof_gh_interface-2025

io = IO(
    SofistikDocumentProperties_Settings="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",
    SofistikDocumentProperties_VersionMajor="2025",
    SofistikDocumentProperties_VersionMinor="6")

# ----
# Stütze 1
# Stütze 2 - Mitte
# Stütze 3
# Balken St.1-2
# Balken St.2-3
# Platte
mesh = Mesh(<mesh referenced from the Rhino model>)
mesh_2 = Mesh(<mesh referenced from the Rhino model>)
mesh_3 = Mesh(<mesh referenced from the Rhino model>)
mesh_4 = Mesh(<mesh referenced from the Rhino model>)
mesh_5 = Mesh(<mesh referenced from the Rhino model>)
mesh_6 = Mesh(<mesh referenced from the Rhino model>)
deconstruct_mesh = DeconstructMesh(Mesh=mesh_2)  # -> Vertices, Faces, Colours, Normals
deconstruct_mesh_2 = DeconstructMesh(Mesh=mesh_3)  # -> Vertices, Faces, Colours, Normals
deconstruct_mesh_3 = DeconstructMesh(Mesh=mesh)  # -> Vertices, Faces, Colours, Normals
deconstruct_mesh_4 = DeconstructMesh(Mesh=mesh_5)  # -> Vertices, Faces, Colours, Normals
deconstruct_mesh_5 = DeconstructMesh(Mesh=mesh_4)  # -> Vertices, Faces, Colours, Normals
deconstruct_mesh_6 = DeconstructMesh(Mesh=mesh_6)  # -> Vertices, Faces, Colours, Normals
cull_duplicates = CullDuplicates(Points=deconstruct_mesh_3.Vertices, Tolerance=0.1, CullMode=3)  # -> Points, Indices, Valence
cull_duplicates_2 = CullDuplicates(Points=deconstruct_mesh_5.Vertices, Tolerance=0.1, CullMode=3)  # -> Points, Indices, Valence
cull_duplicates_3 = CullDuplicates(Points=deconstruct_mesh_2.Vertices, Tolerance=0.1, CullMode=3)  # -> Points, Indices, Valence
cull_duplicates_4 = CullDuplicates(Points=deconstruct_mesh_4.Vertices, Tolerance=0.1, CullMode=3)  # -> Points, Indices, Valence
cull_duplicates_5 = CullDuplicates(Points=deconstruct_mesh_6.Vertices, Tolerance=0.1, CullMode=3)  # -> Points, Indices, Valence
fit_line = FitLine(Points=cull_duplicates_5.Points)
fit_line_2 = FitLine(Points=cull_duplicates_2.Points)
fit_line_3 = FitLine(Points=cull_duplicates_4.Points)
fit_line_4 = FitLine(Points=cull_duplicates.Points)
fit_line_5 = FitLine(Points=cull_duplicates_3.Points)

# ----
# Generieren von Punkten - Sofistik
# Ann. Durchlaufträger
control_points = ControlPoints(Curve=fit_line)  # -> Points, Weights, Knots
control_points_2 = ControlPoints(Curve=fit_line_2)  # -> Points, Weights, Knots
control_points_3 = ControlPoints(Curve=fit_line_3)  # -> Points, Weights, Knots
control_points_4 = ControlPoints(Curve=fit_line_5)  # -> Points, Weights, Knots
control_points_5 = ControlPoints(Curve=fit_line_4)  # -> Points, Weights, Knots
point = Point([control_points_2.Points, control_points.Points, control_points_3.Points, control_points_4.Points, control_points_5.Points])
cull_duplicates_6 = CullDuplicates(Points=point, Tolerance=0.1, CullMode=3)  # -> Points, Indices, Valence
list_length = ListLength(List=cull_duplicates_6.Points)
series = Series(Start="0", Step="1", Count=list_length)
panel = Panel("""F

F
F

PYPXPZ
PYPZ
PYPZ""")
text_tag = TextTag(Location=cull_duplicates_6.Points, Text=series, Colour=ColourSwatch(SwatchColor=RGB(255, 255, 255)))
structural_point = StructuralPoint(Point=cull_duplicates_6.Points, SptID=series, Fixation=panel)

# ----
# Strukturlinien generieren - Sofistik
line = Line([fit_line, fit_line_2, fit_line_3, fit_line_5, fit_line_4])
panel_2 = Panel(line)
panel_3 = Panel("""3
4""")
panel_4 = Panel("""0
1
2""")
item = ListItem(List=line, Index=panel_3, Wrap=True)
item_2 = ListItem(List=line, Index=panel_4, Wrap=True)
line_2 = Line(item)
line_3 = Line(item_2)
lng = ListLength(List=line_2)
lng_2 = ListLength(List=line_3)
# Träger
series_2 = Series(Start="201", Step="1", Count=lng)
# Stütze
series_3 = Series(Start="101", Step="1", Count=lng_2)
structural_line = StructuralLine(Curve=line_2, SlnID=series_2, Group=0, Section="2", ElementType="From Section", FESize=0)
structural_line_2 = StructuralLine(Curve=line_3, SlnID=series_3, Group=0, Section="2", ElementType="From Section", FESize=0)

# ----
# Rigid Link generieren
panel_5 = Panel("3")
list_item = ListItem(List=structural_point, Index="6", Wrap=True)
list_item_2 = ListItem(List=structural_point, Index=panel_5, Wrap=True)
list_item_3 = ListItem(List=structural_point, Index="7", Wrap=True)
list_item_4 = ListItem(List=structural_point, Index="8", Wrap=True)
list_item_5 = ListItem(List=structural_point, Index="4", Wrap=True)
list_item_6 = ListItem(List=structural_point, Index="1", Wrap=True)
rigid_link = RigidLink(AGeometry=list_item, BGeometry=list_item_2, Group=0, Fixation="F")
rigid_link_2 = RigidLink(AGeometry=list_item_3, BGeometry=list_item_6, Group=0, Fixation="F")
rigid_link_3 = RigidLink(AGeometry=list_item_4, BGeometry=list_item_5, Group=0, Fixation="F")

# ----
# Sofistikeingabe
data = Data(
    [rigid_link, rigid_link_2, rigid_link_3, structural_line, structural_line_2],
    AlwaysInheritNames=False,
    CanInheritNames=True)
sofimshc = SOFiMSHC(
    StructuralElements=data,
    InitSystem=True,
    MeshSize=0,
    StartIndex=1000,
    GroupDivisor=-1000,
    Interpolate=True,
    Header="Model")  # -> TextInput, Log
panel_6 = Panel(sofimshc.TextInput)
panel_7 = Panel("C:\Users\stric\Studium\FH Campus Wien_MASTER\3.Sem\Digite TWKpl\Übung\Aufgabe\sofimshc.dat")
text_file = TextFile(TextInput=sofimshc.TextInput, FilePath=panel_7, SOF_STREAM_CONTENT=True)

# ----
# Matrikelnr.: XYZ=332
# Eigenlast
# Nutzlast
# Schneelast
# Windlast
panel_8 = Panel("0.1")
multiplication = Multiplication(A=panel_8, B="2")
multiplication_2 = Multiplication(A="3.60", B="4")
multiplication_3 = Multiplication(A="0.28", B="4")
addition = Addition(A="5", B=multiplication)
Z = UnitZ(Factor=multiplication_2)
Y = UnitY(Factor=multiplication_3)
neg = Negative(Value=Z)
Z_2 = UnitZ(Factor=addition)
neg_2 = Negative(Value=Y)
neg_3 = Negative(Value=Z_2)
line_ld = LineLoad(CurveSln=structural_line, Loadcase="10", Force=neg_3, Moment=Vector(0, 0, 0), HostLocal=False)
line_ld_2 = LineLoad(CurveSln=structural_line, Loadcase="1", Force=Vector(0, 0, 0), Moment=Vector(0, 0, 0), HostLocal=False)
line_ld_3 = LineLoad(CurveSln=structural_line, Loadcase="20", Force=neg, Moment=Vector(0, 0, 0), HostLocal=False)
line_ld_4 = LineLoad(CurveSln=structural_line_2, Loadcase="31", Force=Y, Moment=Vector(0, 0, 0), HostLocal=False)
line_ld_5 = LineLoad(CurveSln=structural_line_2, Loadcase="30", Force=neg_2, Moment=Vector(0, 0, 0), HostLocal=False)
panel_9 = Panel("""Eigenlast
Nutzlast
Schneelast
Windlast
Windlast rev""")
panel_10 = Panel("""1
0
0
0
0""")
panel_11 = Panel("""G
Q
S
W
W""")
lcattr = LoadcaseAttributes(Loadcase=["1", "10", "20", "30", "31"], Action=panel_11, FacDeadload=panel_10, Title=panel_9)
data_2 = Data([line_ld_2, line_ld, line_ld_3, line_ld_5, line_ld_4])
sofiload = SOFiLOAD(Loads=data_2, LCAttributes=lcattr)  # -> TextInput, Log
panel_12 = Panel(sofiload.TextInput)
panel_13 = Panel("C:\Users\stric\Studium\FH Campus Wien_MASTER\3.Sem\Digite TWKpl\Übung\Aufgabe\Sofiload.dat")
textfile = TextFile(TextInput=sofiload.TextInput, FilePath=panel_13, SOF_STREAM_CONTENT=True)

# ----
# Schnittgrößenermittlung
panel_14 = Panel(["20", "30", "31", "10", "1"])
ase = ASE(Loadcase=panel_14, Threads=-1, Header="Berechnung")  # -> TextInput, Log
panel_15 = Panel(ase.TextInput)
panel_16 = Panel("C:\Users\stric\Studium\FH Campus Wien_MASTER\3.Sem\Digite TWKpl\Übung\Aufgabe\ASE.dat")
text_file_2 = TextFile(TextInput=ase.TextInput, FilePath=panel_16, SOF_STREAM_CONTENT=True)
